# Dynamo graph AMG_DeAl_Przeplyw obliczeniowy kanalizacji sanitarnej.dyn (Dynamo 2.5.0.7460)

categories = Categories("OST_PipeCurves")

# group: Filtrowanie rur po systemie
all_elements_of_category = ElementsOfCategory(Category=categories)
code_block = CodeBlock { "Typ systemu"; }
getParameterValueByName = Element.GetParameterValueByName(element=all_elements_of_category, parameterName=code_block)
name = Element.Name(element=getParameterValueByName)
code_block_2 = CodeBlock { "KS_WEW."; }
eq = name == code_block_2
filterByBoolMask = List.FilterByBoolMask(list=all_elements_of_category, mask=eq)

# group: Pobranie przepływów jednostkowych
code_block_3 = CodeBlock { "Przepływ"; }
# note: Pobiera pojedyncze i zsumowane przepływy DU
getParameterValueByName_2 = Element.GetParameterValueByName(element=filterByBoolMask.in, parameterName=code_block_3)

# group: Wybór rur (podejść) o przepływie jednostkowym DU
python_script = Python(IN[0]=getParameterValueByName_2, IN[1]=filterByBoolMask.in)
# ---------- python_script.python (31 lines) ----------
# Wczytaj biblioteki Python Standard i DesignScript
from posixpath import split
import sys
import clr
clr.AddReference('ProtoGeometry')
from Autodesk.DesignScript.Geometry import *

# Wartości wejściowe do tego węzła będą przechowywane w postaci listy w zmiennych IN.
DUAll = IN[0]
PipeAll = IN[1]

#Połączenie rur i przepływów
x = zip(DUAll, PipeAll)

#Posortowanie elementów od najmniejszego
x.sort()

#Filtrowanie elemetów: odpływy jednostkowe i sumy odpływów.
DU_05 = list(filter(lambda x: x[0] == 0.5, x))
DU_08 = list(filter(lambda x: x[0] == 0.8, x))
DU_25 = list(filter(lambda x: x[0] == 2.5, x))

TylkoDU = DU_05 + DU_08 + DU_25                 #Tylko odpływy jednostkowe
SumyDU = list(set(x).difference(TylkoDU))       #Pozostałe, sumy odpływów

#Określenie średnic rur przy przepływach TylkoDU (odpływy jednostkowe od urządzeń)
x_DU = [i[1] for i in TylkoDU]
x_Pipe = [i[0] for i in TylkoDU]
    
# Przypisz dane wyjściowe do zmiennej OUT.
OUT = x_DU, x_Pipe, SumyDU
# ----------------------------------------
watch = Watch(python_script)

# group: Ustawienie średnicy fi50 dla podejść
code_block_4 = CodeBlock { 1; }
getItemAtIndex = List.GetItemAtIndex(list=python_script, index=code_block_4)
code_block_5 = CodeBlock { 0; }
getItemAtIndex_2 = List.GetItemAtIndex(list=python_script, index=code_block_5)
code_block_6 = CodeBlock { "Średnica"; }
code_block_7 = CodeBlock { 50; }
setParameterByName = Element.SetParameterByName(element=getItemAtIndex_2, parameterName=code_block_6, value=code_block_7)
